# Dynamo graph ImagesExportToFolder.dyn "2.x ImagesExportToFolder" (Dynamo 2.12.0.5650)

# group: 2) Replace existing? True: replace False: skip
replace_existing_images = BoolSelector(false)  # graph input

# group: All Elements of ImageType in project
code_block = CodeBlock { DSCore.Types.FindTypeByNameInAssembly("ImageType", "RevitAPI"); }
all_elements_of_type = ElementsOfType(element_type=code_block)

# group: 1) Select Folder
directory_path = Directory("No file selected.")  # graph input

# group: Make image file paths
name = FamilyType.Name(familyType=all_elements_of_type)
code_block_2 = CodeBlock(directory_=directory_path, name_=name) { paths_ = directory_ + '\' + name_; }

code_block_3 = CodeBlock(names_=name) { names_; }

# group: Get Images
imagetype_getimage_py = Python(IN[0]=all_elements_of_type)  # IronPython2
# ---------- imagetype_getimage_py.python (18 lines) ----------
import clr

clr.AddReference("RevitAPI")
from Autodesk.Revit.DB import ImageType


def tolist(obj1):
    # convert to list if not list
    if hasattr(obj1, "__iter__"):
        return obj1
    return [obj1]


img_types = UnwrapElement(tolist(IN[0]))  # ImageTypes

images = [img_type.GetImage() for img_type in img_types]

OUT = images
# ----------------------------------------

code_block_4 = CodeBlock(paths_=code_block_2, images_=imagetype_getimage_py) { paths_; images_; }
fileExists = FileSystem.FileExists(path=code_block_4.paths_)
code_block_5 = CodeBlock(replace_=replace_existing_images, names_=code_block_3, exists_=fileExists) { replace_; names_; exists_; }

# group: Exclude existing paths
filterByBoolMask = List.FilterByBoolMask(list=code_block_4.paths_, mask=fileExists)

# group: Exclude existing images
filterByBoolMask_2 = List.FilterByBoolMask(list=code_block_4.images_, mask=fileExists)

code_block_6 = CodeBlock(filtered_paths=filterByBoolMask.out, paths_=code_block_4.paths_, images_=code_block_4.images_, filtered_images=filterByBoolMask_2.out) { filtered_paths; paths_; images_; filtered_images; }
if_ = RefactoredIf(test=code_block_5.replace_, true=code_block_6.paths_, false=code_block_6.filtered_paths)
if_2 = RefactoredIf(test=code_block_5.replace_, true=code_block_6.images_, false=code_block_6.filtered_images)

# group: Export images to folder
writeToFile = Image.WriteToFile(path=if_, image=if_2)

# group: Description
description = StringInput("""Export all imported images of the project to specified folder.

1) Select folder for images export;
2) Choose whether to replace existing pictures with the same name or skip them.""")  # graph input

# group: Export folder path
exported_to = Watch(directory_path)  # graph output

# group: Report
code_block_7 = CodeBlock(replace_=code_block_5.replace_, names_=code_block_5.names_, exists_=code_block_5.exists_)
# ---------- code_block_7.designscript (14 lines) ----------
//Export images names,
//add "replaced" or "skipped" note
//depending on input
replace_;
names_;
exists_;

exists_?
//if exists:
    replace_?
        names_ + " - already exists (replaced)":
        names_ + " - already exists (skipped)":
//if does not exist:
names_;
# ----------------------------------------
exported_images = Watch(code_block_7.out3)  # graph output
