# Dynamo graph FacePaintApply_DS.dyn (Dynamo 2.12.0.5650)
# packages: Data-Shapes 2022.2.102

# note: Dynamo 2.12
# Custom Packages:
# - Data-Shapes 2022.2.102
# 2022.05.20
description = StringInput("""Batch apply paint to selected faces

1) Select Faces
2) Select Material
3) Override Existing Paint?""")  # graph input
code_block = CodeBlock { "Batch apply paint to selected faces"; "Apply Paint"; }

# group: Data-Shapes | Select Faces
code_block_2 = CodeBlock { "Select Faces to Paint"; "Select and press Finish"; }
selectfaces_data = Custom[SelectFaces Data](InputName=code_block_2.out0, ButtonText=code_block_2.out1)  # package Data-Shapes; Creates a Revit face selection input for UI.MultipleInputForm++. Check out www.data-shapes.net for more infos!

# group: Get All Materials
code_block_3 = CodeBlock { "OST_Materials"; }
byName = Category.ByName(name=code_block_3)
all_elements_of_category = ElementsOfCategory(Category=byName)

# group: Data-Shapes | Select Materials
code_block_4 = CodeBlock { "Select Material"; }
name = Material.Name(material=all_elements_of_category)
boolean = BoolSelector(true)
dropdown_data = Custom[DropDown Data](InputName=code_block_4, Keys=name, Values=all_elements_of_category, Sorted_optional=boolean)  # package Data-Shapes; Create data for DropDown input in UI.MultiInputForm ++ . Check out www.data-shapes.net for more infos.

# group: Data-Shapes | Override Existing Paint?
code_block_5 = CodeBlock()
# ---------- code_block_5.designscript (5 lines) ----------
"Override
Existing Paint?";
["Yes", "No"];
[true, false];
1;
# ----------------------------------------
radiobuttons_data = Custom[RadioButtons Data](InputName=code_block_5.out0, Keys=code_block_5.out1, Values=code_block_5.out2, DefaultValueIndex=code_block_5.out3)  # package Data-Shapes; Create radio buttons input for UI.MultipleInputForm ++ .

list_create = List.Create(item0=selectfaces_data, item1=dropdown_data, item2=radiobuttons_data)
boolean_2 = BoolSelector(true)
multipleinputform = Custom[MultipleInputForm ++](Description_optional=code_block.out0, ButtonText_optional=code_block.out1, Inputs=list_create, Toggle=boolean_2)  # package Data-Shapes; Create a form with multiple inputs. see www.data-shapes.net for tutorials and infos!
code_block_6 = CodeBlock(out=multipleinputform.User_Inputs) { faces = out[0]; mat[1] = out[1]; override = out[2]; }

# group: Try To Apply Paint
paintapplytofaces_py = Python(IN[0]=code_block_6.faces, IN[1]=code_block_6.out1, IN[2]=code_block_6.override)  # IronPython2
# ---------- paintapplytofaces_py.python (41 lines) ----------
import clr
clr.AddReference('RevitAPI')
from Autodesk.Revit.DB import *
clr.AddReference("RevitNodes")
import Revit
clr.ImportExtensions(Revit.GeometryConversion)
clr.AddReference("RevitServices")
import RevitServices
from RevitServices.Persistence import DocumentManager
from RevitServices.Transactions import TransactionManager
doc =  DocumentManager.Instance.CurrentDBDocument

surfs = UnwrapElement(IN[0])
mat = UnwrapElement(IN[1])
override = IN[2]

paint_applied = []
paint_ignored = []
failed_to_apply = []
failure_exceptions = []

for surf in surfs:
    try:
        ref = surf.Tags.LookupTag("RevitFaceReference")
        elem = doc.GetElement(ref)
        face = elem.GetGeometryObjectFromReference(ref)
        if not (override) and doc.IsPainted(elem.Id, face):
            paint_ignored.append(surf)
        else:
            TransactionManager.Instance.EnsureInTransaction(doc)
            doc.Paint(elem.Id, face, mat.Id)
            TransactionManager.Instance.TransactionTaskDone()
            if doc.IsPainted(elem.Id, face):
                paint_applied.append(surf)
            else:
                failed_to_apply.append(surf)
    except Exception as e:
        failed_to_apply.append(surf)
        failure_exceptions.append(str(e))

OUT = surfs, paint_applied, paint_ignored, failed_to_apply, failure_exceptions
# ----------------------------------------

# group: Results
code_block_7 = CodeBlock(mat=code_block_6.out1, out=paintapplytofaces_py)
# ---------- code_block_7.designscript (7 lines) ----------
["Material:" + mat,
"Faces: " + DSCore.List.Count(out[0]),
"Paint applied: " + DSCore.List.Count(out[1]),
"Already painted and not overriden: " + DSCore.List.Count(out[2]),
"Failed to apply paint: " + DSCore.List.Count(out[3]),
"Reasons of failure:",
DSCore.List.UniqueItems(out[4])];
# ----------------------------------------
result = Watch(code_block_7)  # graph output
