# Dynamo graph FacePaintRemove.dyn (Dynamo 2.12.0.5650)

# note: Script Name: 2.x FacePaintRemove.dyn
# Dynamo 2.6
# 2020.12.17
description = StringInput("""Batch remove paint from selected faces

1) Select Faces
2) Press Run""")  # graph input
select_faces = SelectFaces()  # 209 picked in the model; graph input
flatten = List.Flatten(list=select_faces)
facepaintremove_py = Python(IN[0]=flatten)  # IronPython2
# ---------- facepaintremove_py.python (41 lines) ----------
import clr
clr.AddReference('RevitAPI')
from Autodesk.Revit.DB import *
clr.AddReference("RevitNodes")
import Revit
clr.ImportExtensions(Revit.GeometryConversion)
clr.AddReference("RevitServices")
import RevitServices
from RevitServices.Persistence import DocumentManager
from RevitServices.Transactions import TransactionManager
doc =  DocumentManager.Instance.CurrentDBDocument

surfs = UnwrapElement(IN[0])

was_painted = []
was_not_painted = []
paintRemoved = []
failed_to_remove = []
failure_exceptions = []

for surf in surfs:
    try:
        ref = surf.Tags.LookupTag("RevitFaceReference")
        elem = doc.GetElement(ref)
        face = elem.GetGeometryObjectFromReference(ref)
        if doc.IsPainted(elem.Id, face):
            was_painted.append(face.Id)
            TransactionManager.Instance.EnsureInTransaction(doc)
            doc.RemovePaint(elem.Id, face)
            TransactionManager.Instance.TransactionTaskDone()
            if doc.IsPainted(elem.Id, face):
                failed_to_remove.append(face.Id)
            else:
                paintRemoved.append(face.Id)
        else:
            was_not_painted.append(face.Id)
    except Exception as e:
        failed_to_remove.append(surf)
        failure_exceptions.append(str(e))

OUT = surfs, was_painted, was_not_painted, paintRemoved, failed_to_remove, failure_exceptions
# ----------------------------------------
code_block = CodeBlock(out=facepaintremove_py)
# ---------- code_block.designscript (7 lines) ----------
["Faces: " + DSCore.List.Count(out[0]),
"Was painted: " + DSCore.List.Count(out[1]),
"Was not painted: " + DSCore.List.Count(out[2]),
"Paint removed: " + DSCore.List.Count(out[3]),
"Failed to rmove paint: " + DSCore.List.Count(out[4]),
"Reasons of failure:",
DSCore.List.UniqueItems(out[5])];
# ----------------------------------------
result = Watch(code_block)  # graph output
