# Dynamo graph MaterialCreateNewByColorRAL.dyn (Dynamo 2.12.0.5650)
# packages: archi-lab.net 2021.25.2621

# group: Input RAL
input_ral = StringInput("2002, 2005")  # graph input

# group: Remove spaces and convert String to List
code_block = CodeBlock { " "; ""; }
replace = String.Replace(string=input_ral, searchFor=code_block.out0, replaceWith=code_block.out1)
code_block_2 = CodeBlock { ","; }
split = String.Split(string=replace, separator0=code_block_2)

# group: Convert RAL to RGB
ral_to_rgb_py = Python()  # IronPython2; unwired: IN[0]
# ---------- ral_to_rgb_py.python (220 lines) ----------
#RAL Classic color to sRGB from wiki: https://en.wikipedia.org/wiki/List_of_RAL_colors
#except RAL 2017 and RAL 9012, they are from https://ral-colours.co.uk/ral-search/

RAL = {"1000":["Green beige",201,187,136],
"1001":["Beige",204,176,131],
"1002":["Sand yellow",205,170,109],
"1003":["Signal yellow",242,169,0],
"1004":["Golden yellow",221,159,0],
"1005":["Honey yellow",197,143,0],
"1006":["Maize yellow",219,145,0],
"1007":["Daffodil yellow",226,141,0],
"1011":["Brown beige",171,129,79],
"1012":["Lemon yellow",214,176,37],
"1013":["Oyster white",225,218,199],
"1014":["Ivory",217,197,154],
"1015":["Light ivory",227,211,181],
"1016":["Sulfur yellow",232,222,53],
"1017":["Saffron yellow",240,170,80],
"1018":["Zinc yellow",242,203,46],
"1019":["Grey beige",162,143,122],
"1020":["Olive yellow",157,143,101],
"1021":["Rape yellow",238,183,0],
"1023":["Traffic yellow",239,183,0],
"1024":["Ochre yellow",181,144,75],
"1026":["Luminous yellow",255,255,0],
"1027":["Curry",162,128,12],
"1028":["Melon yellow",255,156,0],
"1032":["Broom yellow",219,164,0],
"1033":["Dahlia yellow",243,155,27],
"1034":["Pastel yellow",230,157,81],
"1035":["Pearl beige",142,131,112],
"1036":["Pearl gold",125,101,63],
"1037":["Sun yellow",234,147,0],
"2000":["Yellow orange",213,111,0],
"2001":["Red orange",182,72,28],
"2002":["Vermilion",188,56,35],
"2003":["Pastel orange",241,120,41],
"2004":["Pure orange",222,83,6],
"2005":["Luminous orange",255,75,17],
"2007":["Luminous bright orange",255,183,0],
"2008":["Bright red orange",232,107,34],
"2009":["Traffic orange",218,83,10],
"2010":["Signal orange",204,93,41],
"2011":["Deep orange",221,110,15],
"2012":["Salmon orange",209,101,78],
"2013":["Pearl orange",143,62,38],
"2017":["Orange",250,68,2],
"3000":["Flame red",164,40,33],
"3001":["Signal red",152,35,35],
"3002":["Carmine red",152,34,34],
"3003":["Ruby red",132,25,34],
"3004":["Purple red",105,27,35],
"3005":["Wine red",88,24,31],
"3007":["Black red",61,32,34],
"3009":["Oxide red",102,48,41],
"3011":["Brown red",119,36,36],
"3012":["Beige red",194,133,109],
"3013":["Tomato red",149,46,37],
"3014":["Antique pink",201,115,117],
"3015":["Light pink",215,160,166],
"3016":["Coral red",164,60,48],
"3017":["Rose",200,84,93],
"3018":["Strawberry red",196,62,74],
"3020":["Traffic red",184,29,19],
"3022":["Salmon pink",204,105,85],
"3024":["Luminous red",255,42,36],
"3026":["Luminous bright red",255,38,32],
"3027":["Raspberry red",169,38,61],
"3028":["Pure red",201,43,38],
"3031":["Orient red",164,51,56],
"3032":["Pearl ruby red",110,28,36],
"3033":["Pearl pink",162,57,46],
"4001":["Red lilac",131,96,131],
"4002":["Red violet",140,60,75],
"4003":["Heather violet",196,96,140],
"4004":["Claret violet",100,29,57],
"4005":["Blue lilac",123,103,154],
"4006":["Traffic purple",145,48,115],
"4007":["Purple violet",71,36,60],
"4008":["Signal violet",135,75,131],
"4009":["Pastel violet",157,133,146],
"4010":["Telemagenta",187,62,119],
"4011":["Pearl violet",113,98,135],
"4012":["Pearl blackberry",109,107,127],
"5000":["Violet blue",56,78,111],
"5001":["Green blue",29,76,100],
"5002":["Ultramarine blue",30,54,123],
"5003":["Sapphire blue",38,56,85],
"5004":["Black blue",26,30,40],
"5005":["Signal blue",0,81,135],
"5007":["Brilliant blue",66,106,140],
"5008":["Grey blue",45,58,68],
"5009":["Azure blue",45,94,120],
"5010":["Gentian blue",0,78,124],
"5011":["Steel blue",30,43,61],
"5012":["Light blue",46,136,182],
"5013":["Cobalt blue",34,48,83],
"5014":["Pigeon blue",104,124,150],
"5015":["Sky blue",11,123,176],
"5017":["Traffic blue",0,90,140],
"5018":["Turquoise blue",27,139,140],
"5019":["Capri blue",15,93,132],
"5020":["Ocean blue",0,65,75],
"5021":["Water blue",0,117,119],
"5022":["Night blue",43,44,90],
"5023":["Distant blue",74,104,141],
"5024":["Pastel blue",103,146,172],
"5025":["Pearl Gentian blue",44,105,124],
"5026":["Pearl night blue",27,47,82],
"6000":["Patina green",59,116,96],
"6001":["Emerald green",49,104,52],
"6002":["Leaf green",45,90,39],
"6003":["Olive green",78,83,59],
"6004":["Blue green",8,68,66],
"6005":["Moss green",17,66,50],
"6006":["Grey olive",59,57,46],
"6007":["Bottle green",42,50,34],
"6008":["Brown green",54,52,42],
"6009":["Fir green",39,54,42],
"6010":["Grass green",72,111,56],
"6011":["Reseda green",105,125,88],
"6012":["Black green",48,61,58],
"6013":["Reed green",122,118,90],
"6014":["Yellow olive",70,65,53],
"6015":["Black olive",60,61,54],
"6016":["Turquoise green",0,106,76],
"6017":["May green",83,128,63],
"6018":["Yellow green",89,154,57],
"6019":["Pastel green",183,206,172],
"6020":["Chrome green",54,66,47],
"6021":["Pale green",135,154,119],
"6022":["Olive-drab/brown olive",57,51,39],
"6024":["Traffic green",0,132,80],
"6025":["Fern green",90,110,59],
"6026":["Opal green",0,95,78],
"6027":["Light green",128,186,181],
"6028":["Pine green",48,84,66],
"6029":["Mint green",0,112,60],
"6032":["Signal green",28,128,81],
"6033":["Mint turquoise",72,135,127],
"6034":["Pastel turquoise",124,173,172],
"6035":["Pearl green",19,77,36],
"6036":["Pearl opal green",7,88,75],
"6037":["Pure green",0,140,39],
"6038":["Luminous green",0,182,18],
"7000":["Squirrel grey",123,136,142],
"7001":["Silver grey",142,150,157],
"7002":["Olive grey",127,120,99],
"7003":["Moss grey",120,119,105],
"7004":["Signal grey",155,155,155],
"7005":["Mouse grey",107,110,107],
"7006":["Beige grey",117,106,94],
"7008":["Khaki grey",114,95,60],
"7009":["Green grey",92,96,88],
"7010":["Tarpaulin grey",88,92,86],
"7011":["Iron grey",83,89,93],
"7012":["Basalt grey",88,93,94],
"7013":["Brown grey",86,80,68],
"7015":["Slate grey",80,83,89],
"7016":["Anthracite grey",56,62,66],
"7021":["Black grey",48,50,52],
"7022":["Umbra grey",76,74,68],
"7023":["Concrete grey",127,128,118],
"7024":["Graphite grey",70,73,79],
"7026":["Granite grey",56,67,69],
"7030":["Stone grey",145,142,133],
"7031":["Blue grey",93,104,109],
"7032":["Pebble grey",180,176,161],
"7033":["Cement grey",126,130,116],
"7034":["Yellow grey",144,136,111],
"7035":["Light grey",197,199,196],
"7036":["Platinum grey",151,147,146],
"7037":["Dusty grey",122,123,122],
"7038":["Agate grey",175,177,169],
"7039":["Quartz grey",106,102,94],
"7040":["Window grey",152,158,161],
"7042":["Traffic grey A",142,146,145],
"7043":["Traffic grey B",79,82,80],
"7044":["Silk grey",182,179,168],
"7045":["Telegrey 1",142,146,149],
"7046":["Telegrey 2",127,134,138],
"7047":["Telegrey 4",200,200,199],
"7048":["Pearl mouse grey",128,123,115],
"8000":["Green brown",134,106,62],
"8001":["Ochre brown",153,99,43],
"8002":["Signal brown",119,77,62],
"8003":["Clay brown",124,75,39],
"8004":["Copper brown",138,73,49],
"8007":["Fawn brown",109,70,43],
"8008":["Olive brown",111,74,37],
"8011":["Nut brown",88,56,39],
"8012":["Red brown",100,51,43],
"8014":["Sepia brown",72,53,38],
"8015":["Chestnut brown",93,47,39],
"8016":["Mahogany brown",75,43,32],
"8017":["Chocolate brown",67,47,41],
"8019":["Grey brown",61,54,53],
"8022":["Black brown",26,23,25],
"8023":["Orange brown",160,87,41],
"8024":["Beige brown",118,80,56],
"8025":["Pale brown",115,88,71],
"8028":["Terra brown",79,58,42],
"8029":["Pearl copper",125,64,49],
"9001":["Cream",231,225,210],
"9002":["Grey white",214,213,203],
"9003":["Signal white",236,236,231],
"9004":["Signal black",43,43,44],
"9005":["Jet black",14,14,16],
"9006":["White aluminium",161,161,160],
"9007":["Grey aluminium",134,133,129],
"9010":["Pure white",240,237,225],
"9011":["Graphite black",39,41,43],
"9012":["Clean room white",255,253,230],
"9016":["Traffic white",240,241,234],
"9017":["Traffic black",42,41,42],
"9018":["Papyrus white",199,203,196],
"9022":["Pearl light grey",133,133,131],
"9023":["Pearl dark grey",121,123,123]}

OUT = RAL
# ----------------------------------------
valueAtKey = DesignScript.Builtin.Dictionary.ValueAtKey(dictionary=ral_to_rgb_py, key=split)
code_block_3 = CodeBlock(RGB=valueAtKey)
# ---------- code_block_3.designscript (4 lines) ----------
//Take RGB values
DSCore.List.GetItemAtIndex(RGB@L2<1>, 1);
DSCore.List.GetItemAtIndex(RGB@L2<1>, 2);
DSCore.List.GetItemAtIndex(RGB@L2<1>, 3);
# ----------------------------------------
byARGB = Color.ByARGB(red=code_block_3.out0, green=code_block_3.out1, blue=code_block_3.out2)

# group: Input: Add Color Name to Material Name?
add_color_name_to_material_name = BoolSelector(true)  # graph input

# group: Generate Material and Asset Names
number = DoubleInput(0)
getItemAtIndex = List.GetItemAtIndex(list=valueAtKey@L2, index=number)
names_py = Python(IN[0]=split, IN[1]=getItemAtIndex, IN[2]=add_color_name_to_material_name)  # IronPython2
# ---------- names_py.python (31 lines) ----------
#Generate Names for Materials and Appearance Assets acc to RAL code

RALcode = IN[0] #RAL Code
colName = IN[1] #Color Name
state = IN[2] #bool

## convert item to list if it is not list
def makeList(item): 
    item = item if isinstance(item, list) else [item]
    return item

RALcode = makeList(RALcode)
colName = makeList(colName)

mNames = [] #Material Names
aNames = [] #Appearance Asset Names

for r,c in zip(RALcode, colName):
    if c == None: ##Exception for null
        raise Exception("null input is not allowed. Check your input, probably some RAL does not exist")
    elif state: #Names with RAL Code and Name
        mNam = "MF_Color RAL " + str(r) + " " + c
        aNam = "MF_Color RAL " + str(r) + " " + c
    else: #Names with RAL Code only
        mNam = "MF_Color RAL " + str(r)
        aNam = "MF_Color RAL " + str(r)

    mNames.append(mNam)
    aNames.append(aNam)

OUT = mNames, aNames
# ----------------------------------------
code_block_4 = CodeBlock(makeName=names_py)
# ---------- code_block_4.designscript (4 lines) ----------
//matName
DSCore.List.GetItemAtIndex(makeName@L2<0>, 0);
//assetName
DSCore.List.GetItemAtIndex(makeName@L2<0>, 1);
# ----------------------------------------

# group: Get all Materials and their Names
code_block_5 = CodeBlock { Revit.Category.ByName("Materials"); }
all_elements_of_category = ElementsOfCategory(Category=code_block_5)
name = Material.Name(material=all_elements_of_category)

# group: Reset Existing RAL Materials?
reset_existing_ral_materials = BoolSelector(false)  # graph input

code_block_6 = CodeBlock(c=byARGB) { c; }

# group: Filter Materials with new RAL Names
code_block_7 = CodeBlock(aN=code_block_4.out1, mN=code_block_4.out0, omN=name) { aN; mN; omN; }
# note: New Mat Names
setDifference = List.SetDifference(list1=code_block_7.mN, list2=code_block_7.omN)
indexOf = List.IndexOf(list=code_block_7.mN, element=setDifference)
# note: New Asset Names
getItemAtIndex_2 = List.GetItemAtIndex(list=code_block_7.aN, index=indexOf)
# note: Colors
getItemAtIndex_3 = List.GetItemAtIndex(list=code_block_6, index=indexOf)

# group: Create and setup New Appearance Assets | archilab
createViaDuplicate = archilab.Revit.Elements.AppearanceAssets.CreateViaDuplicate(name=getItemAtIndex_2)
setGenericProperties = archilab.Revit.Elements.AppearanceAssets.SetGenericProperties(appearanceAsset=createViaDuplicate, color=getItemAtIndex_3)

# group: Create and setup New Materials | archilab
create = archilab.Revit.Elements.Materials.Create(name=setDifference)
setAppearanceAsset = archilab.Revit.Elements.Materials.SetAppearanceAsset(material=create, appearanceAsset=createViaDuplicate)
code_block_8 = CodeBlock { true; }
useRenderAppearanceForShading = archilab.Revit.Elements.Materials.UseRenderAppearanceForShading(material=setAppearanceAsset, check=code_block_8)

# group: Filter Materials with RAL Names already exist in Project
code_block_9 = CodeBlock(mN=code_block_4.out0, aN=code_block_4.out1) { mN; aN; }
# note: Existing Mat Names
setIntersection = List.SetIntersection(list1=name, list2=code_block_9.mN)
indexOf_2 = List.IndexOf(list=name, element=setIntersection)
# note: Existing Mats
getItemAtIndex_4 = List.GetItemAtIndex(list=all_elements_of_category, index=indexOf_2)
indexOf_3 = List.IndexOf(list=code_block_9.mN, element=setIntersection)
# note: Colors
getItemAtIndex_5 = List.GetItemAtIndex(list=code_block_6, index=indexOf_3)
# note: Existing Asset Names
getItemAtIndex_6 = List.GetItemAtIndex(list=code_block_9.aN, index=indexOf_3)  # frozen

# group: Reset Existing Materials | archilab
reset_material_py = Python(IN[0]=reset_existing_ral_materials, IN[1]=getItemAtIndex_4)  # IronPython2
# ---------- reset_material_py.python (64 lines) ----------
#Reset Material Properties to default

import clr
clr.AddReference('RevitAPI')
import Autodesk
from Autodesk.Revit.DB import *

clr.AddReference("RevitNodes")
import Revit
clr.ImportExtensions(Revit.Elements)

clr.AddReference("RevitServices")
import RevitServices
from RevitServices.Persistence import DocumentManager
from RevitServices.Transactions import TransactionManager

## convert item to list if it is not list
def toList(item): 
    item = item if isinstance(item, list) else [item]
    return item

doc = DocumentManager.Instance.CurrentDBDocument
uiapp = DocumentManager.Instance.CurrentUIApplication
app = uiapp.Application
revVer=int(app.VersionNumber)

state = IN[0] #bool
materials = UnwrapElement(toList(IN[1]))

if state:

    TransactionManager.Instance.EnsureInTransaction(doc)

    for m in materials:
        if revVer < 2019:
            m.UseRenderAppearanceForShading = False
            m.Color = Autodesk.Revit.DB.Color.InvalidColorValue
            m.SurfacePatternId = surfaceForegroundPattern.Id
            m.SurfacePatternColor = Autodesk.Revit.DB.Color.InvalidColorValue
            m.SurfacePatternId = ElementId.InvalidElementId
            m.SurfacePatternColor = Autodesk.Revit.DB.Color.InvalidColorValue
            m.CutPatternId = ElementId.InvalidElementId
            m.CutPatternColor = Autodesk.Revit.DB.Color.InvalidColorValue
            m.CutPatternId = ElementId.InvalidElementId
            m.CutPatternColor = Autodesk.Revit.DB.Color.InvalidColorValue

        else:
            m.UseRenderAppearanceForShading = False
            m.Color = Autodesk.Revit.DB.Color.InvalidColorValue
            m.SurfaceForegroundPatternId = ElementId.InvalidElementId
            m.SurfaceForegroundPatternColor = Autodesk.Revit.DB.Color.InvalidColorValue
            m.SurfaceBackgroundPatternId = ElementId.InvalidElementId
            m.SurfaceBackgroundPatternColor = Autodesk.Revit.DB.Color.InvalidColorValue
            m.CutForegroundPatternId = ElementId.InvalidElementId
            m.CutForegroundPatternColor = Autodesk.Revit.DB.Color.InvalidColorValue
            m.CutBackgroundPatternId = ElementId.InvalidElementId
            m.CutBackgroundPatternColor = Autodesk.Revit.DB.Color.InvalidColorValue

    TransactionManager.Instance.TransactionTaskDone()

else:
    IN[1] = []#empty list if state is false

OUT = IN[1]
# ----------------------------------------
setColor = archilab.Revit.Elements.Materials.SetColor(material=reset_material_py, color=getItemAtIndex_5)
assets = archilab.Revit.Elements.Materials.Assets(material=setColor)

# group: Set color of Appearance Assets for Existing Materials | archilab
setGenericProperties_2 = archilab.Revit.Elements.AppearanceAssets.SetGenericProperties(appearanceAsset=assets.appearanceAsset, color=getItemAtIndex_5)

join = List.Join(list0=setGenericProperties_2, list1=setGenericProperties)

# group: Reset some Parameters to default | archilab
code_block_10 = CodeBlock(asset=join)
# ---------- code_block_10.designscript (8 lines) ----------
asset;
//reset what can//

gl=50;
met=false;
dRefl=0;
oRefl=0;
transp=0;
# ----------------------------------------
setTransparencyProperties = archilab.Revit.Elements.AppearanceAssets.SetTransparencyProperties(appearanceAsset=code_block_10.asset, amount=code_block_10.transp)
setReflectivityProperties = archilab.Revit.Elements.AppearanceAssets.SetReflectivityProperties(appearanceAsset=code_block_10.asset, directReflectivity=code_block_10.dRefl, obliqueReflectivity=code_block_10.oRefl)
setGenericProperties_3 = archilab.Revit.Elements.AppearanceAssets.SetGenericProperties(appearanceAsset=code_block_10.asset, glossiness=code_block_10.gl, metallic=code_block_10.met)  # unwired: color

# note: Script Name: 2.x MaterialCreateNewByColorRAL.dyn
# Dynamo: 2.6
# Packages :
# archilab v.2021.25.2621
# Date: 2021.5.19
description = StringInput("""Create new Generic Material using color from RAL Classic code. 

How to:
1) Input RAL code. If need several, input them separated by comma.
3) Choose if want to have Color Name in Material Name?
4) Reset Properties for Materials with RAL name already exist in Project?
5) Run

New material Name: "MF_Color RAL .... Color Name"

Notes: 
Appearance Asset is created by duplicating material with Name "Default". Check it in case any issues.

If some of RAL does not exist, script will stop.""")  # graph input
fromPixels = Image.FromPixels(colors=byARGB)
color = WatchImageCore(image=fromPixels)  # graph output
new_material = Watch(setDifference)  # graph output
material_with_this_name_already = Watch(setIntersection)  # "Material with this Name already exist in Project."; graph output

# group: Set Appearance Asset to Materials again | archilab
setAppearanceAsset_2 = archilab.Revit.Elements.Materials.SetAppearanceAsset(material=reset_material_py, appearanceAsset=setGenericProperties_2)
code_block_11 = CodeBlock { true; }
useRenderAppearanceForShading_2 = archilab.Revit.Elements.Materials.UseRenderAppearanceForShading(material=setAppearanceAsset_2, check=code_block_11)
