# Dynamo graph LineExtendEndsToClosestLines Face.dyn "2.x LineExtendEndsToClosestLines Face" (Dynamo 2.12.0.5650)

# group: Time count 0 to 60 sec for 500ms frame
now = DateTime.Now()
code_block = CodeBlock { "ss.f"; }
format = DateTime.Format(dateTime=now, format=code_block)
toNumber = String.ToNumber(string=format)
code_block_2 = CodeBlock(a=toNumber) { a*2; }
round = Math.Round(number=code_block_2)

# group: Range for x
code_block_3 = CodeBlock { -500; 500; 120; }
code_block_4 = CodeBlock(start=code_block_3.out0, end=code_block_3.out1, length=code_block_3.out2)
# ---------- code_block_4.designscript (4 lines) ----------
//Range by start, end, length
start;
step = (end - start) / length;
range = start..end..~step;
# ----------------------------------------
code_block_5 = CodeBlock(a=code_block_4.range, i=round) { a[i]; }

# group: Range for y
code_block_6 = CodeBlock { 460; -500; 120; }
code_block_7 = CodeBlock(start=code_block_6.out0, end=code_block_6.out1, length=code_block_6.out2)  # same code as code_block_4
code_block_8 = CodeBlock(a=code_block_7.range, i=round) { a[i]; }

# group: Source Line
rotate = DoubleSlider(90, range=-180..180 step 1)
length = DoubleSlider(150, range=1..2000 step 1)
byStartPointRotationLength = CodeBlock(x=code_block_5, y=code_block_8, angle=rotate, len=length)  # "Line.ByStartPointRotationLength"
# ---------- byStartPointRotationLength.designscript (4 lines) ----------
p1 = Autodesk.Point.ByCoordinates(x, y);
vec1 = Vector.Rotate(Vector.XAxis(), Vector.ZAxis(), angle);
line1 = Line.ByStartPointDirectionLength(p1, vec1, len);
end = Autodesk.Curve.EndPoint(line1);
# ----------------------------------------
X = DoubleSlider(0, range=-2000..2000 step 1)
Y = DoubleSlider(0, range=-2000..2000 step 1)

# group: Range for rot
code_block_9 = CodeBlock { 360; -360; 120; }
code_block_10 = CodeBlock(start=code_block_9.out0, end=code_block_9.out1, length=code_block_9.out2)  # same code as code_block_4
code_block_11 = CodeBlock(a=code_block_10.range, i=round) { a[i]; }

# group: Rotate Source Line
code_block_12 = CodeBlock(line1=byStartPointRotationLength.line1, angle=code_block_11) { p1 = Autodesk.Curve.PointAtParameter(line1, 0.5); v1 = Vector.ZAxis(); rot = Geometry.Rotate(line1, p1, v1, angle); }

# group: Background
origin = Point.Origin()
code_block_13 = CodeBlock { 450; }
byCenterPointRadius = Circle.ByCenterPointRadius(centerPoint=origin, radius=code_block_13)

# group: Background
origin_2 = Point.Origin()
code_block_14 = CodeBlock { 50; }
byCenterPointRadius_2 = Circle.ByCenterPointRadius(centerPoint=origin_2, radius=code_block_14)
code_block_15 = CodeBlock { -220; 100; }
translate = Geometry.Translate(geometry=byCenterPointRadius_2, xTranslation=code_block_15.out0, yTranslation=code_block_15.out1)

# group: Background
origin_3 = Point.Origin()
code_block_16 = CodeBlock { 50; }
byCenterPointRadius_3 = Circle.ByCenterPointRadius(centerPoint=origin_3, radius=code_block_16)
code_block_17 = CodeBlock { 220; 100; }
translate_2 = Geometry.Translate(geometry=byCenterPointRadius_3, xTranslation=code_block_17.out0, yTranslation=code_block_17.out1)

# group: smile
origin_4 = Point.Origin()
code_block_18 = CodeBlock { 300; -150; -30; }
byCenterPointRadiusAngle = Arc.ByCenterPointRadiusAngle(center=origin_4, radius=code_block_18.out0, startAngle=code_block_18.out1, endAngle=code_block_18.out2)
code_block_19 = CodeBlock { 0; }
translate_3 = Geometry.Translate(geometry=byCenterPointRadiusAngle, yTranslation=code_block_19)

list_create = List.Create(item0=byCenterPointRadius, item1=translate, item2=translate_2, item3=translate_3)
lineextendendstoclosestlines_py = Python(IN[0]=code_block_12.rot, IN[1]=list_create)  # IronPython2
# ---------- lineextendendstoclosestlines_py.python (108 lines) ----------
"""
Extend line segment ends to closest line segments or curves

*Hereafter line segment called line and endless line called unbound line.

Process:
1) Convert line_1 to unbound line.
2) Find intersection points between unbound line and other lines.
   If no intersections, return None.
3) Get intersection points behind each end of line_1 (outside of line_1).
4) New end points are closest points to ends.
   If no such point, use existing endpoint.
5) Make new line based on new end points.
"""

import sys
import clr

clr.AddReference("RevitAPI")
clr.AddReference("RevitNodes")
from Autodesk.Revit.DB import *

import Revit

clr.ImportExtensions(Revit.Elements)
clr.ImportExtensions(Revit.GeometryConversion)


def tolist(x):
    if hasattr(x, "__iter__"):
        return x
    return [x]


def get_intersection(line_1, curve):
    # get intersection of line and curve
    # if no intersection, return None
    # orig by Gui Talarico github.com/gtalarico

    results = clr.Reference[IntersectionResultArray]()
    result = line_1.Intersect(curve, results)

    if result == SetComparisonResult.Overlap:
        result_indexes = range(0, results.Size)
        intersection = [results.Item[i].XYZPoint for i in result_indexes]
    else:
        intersection = None
        report = str(result)
    return intersection


line_1 = IN[0].ToRevitType()  # Line to extend
other_lines = [line.ToRevitType() for line in tolist(IN[1])]  # Other lines

end1 = line_1.GetEndPoint(0)
end2 = line_1.GetEndPoint(1)

ub_line = Line.CreateUnbound(end1, line_1.Direction)  # Unbound line

intersections = [get_intersection(ub_line, line) for line in other_lines]

# Remove null items and flatten list of lists
intersections_flat = [
    item for sublist in intersections if sublist for item in sublist
]

# Points behind ends
points_beh_end1 = []
points_beh_end2 = []
for i in intersections_flat:
    if i:  # if has intersection
        ve1e2 = end2.Subtract(end1)  # Vector(end1, end2)
        ve2e1 = end1.Subtract(end2)  # Vector(end2, end1)
        ve1i = i.Subtract(end1)  # Vector(end1, point i)
        ve2i = i.Subtract(end2)  # Vector(end2, point i)
        dotprod_end1 = ve2e1.DotProduct(ve1i)
        dotprod_end2 = ve1e2.DotProduct(ve2i)
        if dotprod_end1 > 0:
            points_beh_end1.append(i)
        if dotprod_end2 > 0:
            points_beh_end2.append(i)

# Closest points behind ends. If no point use existing end.
dist1 = [end1.DistanceTo(p) for p in points_beh_end1]  # Distances to end1
dist2 = [end2.DistanceTo(p) for p in points_beh_end2]  # Distances to end2
if dist1:  # if not empty
    index_of_min1 = dist1.index(min(dist1))  # Index of min distance
    new_end1 = points_beh_end1[index_of_min1]  # Point at index
else:
    new_end1 = end1

if dist2:  # if not empty
    index_of_min2 = dist2.index(min(dist2))  # Index of min distance
    new_end2 = points_beh_end2[index_of_min2]  # Point at index
else:
    new_end2 = end2

# New line by new points.
new_line = Line.CreateBound(new_end1, new_end2).ToProtoType()

# Results
intersec_points = [Point.Create(p).ToProtoType() for p in intersections_flat if p]
old_ends = [Point.Create(e).ToProtoType() for e in (end1, end2)]
new_ends = [Point.Create(e).ToProtoType() for e in (new_end1, new_end2)]

new_line_only = new_line if new_end1 != end1 or new_end2 != end2 else []

OUT = line_1.ToProtoType(), old_ends, intersec_points, new_line_only
# ----------------------------------------
watch = Watch(lineextendendstoclosestlines_py)
rotate_2 = DoubleSlider(0, range=-180..180 step 1)
code_block_20 = CodeBlock(a=lineextendendstoclosestlines_py) { a[0..1]; }
flatten = List.Flatten(list=code_block_20)
color_palette = ColorPalette({R: 0, G: 0, B: 255, A: 255})
byGeometryColor = Modifiers.GeometryColor.ByGeometryColor(geometry=flatten, color=color_palette, lacing=Longest)
code_block_21 = CodeBlock(a=lineextendendstoclosestlines_py) { a[2..3]; }
flatten_2 = List.Flatten(list=code_block_21)
color_palette_2 = ColorPalette({R: 220, G: 20, B: 60, A: 255})
byGeometryColor_2 = Modifiers.GeometryColor.ByGeometryColor(geometry=flatten_2, color=color_palette_2, lacing=Longest)
watch_2 = Watch(toNumber)
